# Grasshopper definition _eponym.gh (Grasshopper 1.0.4)

len = TextLength(Text="chuck")
len_2 = TextLength(Text="christian")
panel = Panel("C:\Users\Chuck Driesler\OneDrive\[17SU] Summer III\sfpc\log.txt")
number_slider = Slider(2, range=0..10)
merge = Merge(Data1=len, Data2=len_2)
merge_2 = Merge(Data1="chuck", Data2="christian")
txt = Text()
file = ReadFile(File=panel, PerLineParse=True)
sort = SortList(Keys=merge)  # -> Keys, ValuesA
number_slider_2 = Slider(5, range=0..10)
item = ListItem(List=sort.Keys, Index=0, Wrap=True)
item_2 = ListItem(List=file, Index=0, Wrap=True)
split = TextSplit(Text=item_2, Separators=",")
fragment = TextFragment(Text=merge_2, Start=Slider(0, range=0..100), Count=item)
item_3 = ListItem(List=fragment, Index=0, Wrap=True)  # -> Item1, Item
multiplication = Multiplication(A=number_slider_2, B=Slider(1.2, range=0..10))
multiplication_2 = Multiplication(A=number_slider_2, B=Slider(0.8, range=0..1))
rep = ReplaceText(Text=split, Find=" ", Replace="x", RecursiveReplace=False)
python = GhPythonScript(text=item_3.Item1, font="hi", height=number_slider_2)  # -> out, crvs
# ---------- python: Python ----------
import Rhino as rc

def flattenList(l):
    return [item for sublist in l for item in sublist]

def text2crv(text, font, textHeight):
    textCrvs = []
    
    for n in range(len(text)):
        textPt = rc.Geometry.Point3d(0,-(1.2 * n * textHeight),0)
        plane = rc.Geometry.Plane(textPt, rc.Geometry.Vector3d(0,0,1))
        
        if type(text[n]) is not str:
            preText = rc.RhinoDoc.ActiveDoc.Objects.AddText(`text[n]`, plane, textHeight, font, True, False)
        else:
            preText = rc.RhinoDoc.ActiveDoc.Objects.AddText(text[n], plane, textHeight, font, True, False)
        
        postText = rc.RhinoDoc.ActiveDoc.Objects.Find(preText)
        TG = postText.Geometry
        crv = TG.Explode()
        textCrvs.append(crv)
        
        rc.RhinoDoc.ActiveDoc.Objects.Delete(postText, True)
        
    return flattenList(textCrvs)

if not font: font = 'Arial'
if not height: textHeight = 20
else: textHeight = float(height)

if text and text[0]!=None:
    crvs = text2crv(text, font, textHeight)
# ---------- end python ----------
python_2 = GhPythonScript(text=item_3.Item, font="hi", height=number_slider_2)  # -> out, crvs; same code as python
rad = Radians(Degrees=Slider(90, range=0..100))
len_3 = TextLength(Text=item_3.Item)
neg = Negative(Value=rad)
Y = UnitY(Factor=1)
rot3d = Rotate3D(Geometry=python_2.crvs, Angle=neg, Center=Point(0, 0, 0), Axis=Y)  # -> Geometry, Transform
Z = UnitZ(Factor=number_slider_2)
X = UnitX(Factor=number_slider_2)
rev = Reverse(Vector=Z)
extr = Extrude(Base=rot3d.Geometry, Direction=X)
extr_2 = Extrude(Base=python.crvs, Direction=Z)
cap = CapHoles(Brep=extr_2)  # -> graft(Brep)
cap_2 = CapHoles(Brep=extr)  # -> graft(Brep)
subtraction = Subtraction()
addition = Addition(A=number_slider_2, B=Slider(5.55, range=0..10))
X_2 = UnitX(Factor=multiplication)
cam_rotation = Slider(490, range=0..1000)
cam_height = Slider(51, range=0..100)
arrlinear = LinearArray(Geometry=cap, Direction=X_2, Count=len_3)  # -> flatten(Geometry), Transform
arrlinear_2 = LinearArray(Geometry=cap_2, Direction=X_2, Count=len_3)  # -> flatten(Geometry), Transform
bbox = BoundingBox(Content=arrlinear_2.Geometry, Plane=PlaneXY(0, 0, 0), UnionBox=True)  # -> Box, Box_2
sdiff = SolidDifference(BrepsA=arrlinear_2.Geometry, BrepsB=arrlinear.Geometry)
volume = Volume(Geometry=bbox.Box)  # -> Volume, Centroid
Z_2 = UnitZ(Factor=multiplication_2)
sdiff_2 = SolidDifference(BrepsA=arrlinear.Geometry, BrepsB=arrlinear_2.Geometry)
pt2num = PointsToNumbers(Points=volume.Centroid, Mask=4)
circle = CircleCNR(Center=volume.Centroid, Normal=Vector(0, 0, 1), Radius=Slider(50, range=0..100))
lng = ListLength(List=sdiff_2)
move = Move(Geometry=sdiff, Motion=Z_2)  # -> Geometry, Transform
Z_3 = UnitZ(Factor=cam_height)
move_2 = Move(Geometry=circle, Motion=Z_3)  # -> Geometry, Transform
random = Random(Range=Domain(0, 1), Number=lng, Seed=2)
lng_2 = ListLength(List=move.Geometry)
divide = DivideCurve(Curve=move_2.Geometry, Count=Slider(300, range=0..1000), Kinks=False)  # -> Points, Tangents, Parameters
item_4 = ListItem(List=pt2num, Index=0, Wrap=True)  # -> Item, Item1, Item2
reduction = Slider(1, range=0..1)
random_2 = Random(Range=Domain(0, 1), Number=lng_2, Seed=2)
multiplication_3 = Multiplication(A=random, B=Slider(10, range=0..10))
item_5 = ListItem(List=divide.Points, Index=cam_rotation, Wrap=True)
Z_4 = UnitZ(Factor=multiplication_3)
multiplication_4 = Multiplication(A=random_2, B=Slider(10, range=0..10))
pt2num_2 = PointsToNumbers(Points=item_5, Mask=4)
item_6 = ListItem(List=pt2num_2, Index=0, Wrap=True)  # -> Item, Item1, Item2
python_3 = PythonScript(xa=item_6.Item, ya=item_6.Item1, za=item_6.Item2, xt=item_4.Item, yt=item_4.Item1, zt=item_4.Item2)  # -> out, a
# ---------- python_3: Python ----------
import rhinoscriptsyntax as rs
from Rhino.Geometry import Point3d

view = rs.CurrentView()
camera_anchor = Point3d(xa, ya, za)
camera_target = Point3d(xt, yt, zt) 

rs.ViewCameraTarget(view, camera_anchor, camera_target)
# ---------- end python_3 ----------
Z_5 = UnitZ(Factor=multiplication_4)
multiplication_5 = Multiplication(A=multiplication_3, B=reduction)
multiplication_6 = Multiplication(A=multiplication_4, B=reduction)
rev_2 = Reverse(Vector=Z_5)
amp = Amplitude(Vector=Z_4, Amplitude=multiplication_5)
amp_2 = Amplitude(Vector=rev_2, Amplitude=multiplication_6)
move_3 = Move(Geometry=sdiff_2, Motion=amp)  # -> Geometry, Transform
move_4 = Move(Geometry=move.Geometry, Motion=amp_2)  # -> Geometry, Transform
merge_3 = Merge(Data1=move_3.Geometry, Data2=move_4.Geometry)
